# Grasshopper definition python説明.gh (Grasshopper 1.0.7)

# ----
# Point2点をつなげてcurveにする
# AddCurveを使用
pt = Point(Point(35.70199421, 2.470485068, 0))
# Brepをsurfaceで切断する
pt_2 = Point(Point(34.2879281, -14.95140996, 0))
merge = Merge(Data1=pt, Data2=pt_2)
python = GhPythonScript(x=merge)  # -> out, a; inputs x: list
# ---------- python: Python ----------
__author__ = "katsu"
__version__ = "2022.04.20"

import rhinoscriptsyntax as rs

#参照リンク https://developer.rhino3d.com/api/RhinoScriptSyntax/#curve-AddCurve
guid = rs.AddCurve(x)

a=guid
# ---------- end python ----------
