# Grasshopper definition データ型説明.gh (Grasshopper 1.0.7)

# ----
# 基本
# Point
# Curve
# Surface
# Brep
srf = Surface(<surface referenced from the Rhino model>)
# Brepはsurfaceも格納できる
brep = Brep(<brep referenced from the Rhino model>)
# 対象（データの型）には何が存在するか？
pt = Point(Point(35.70199421, 2.470485068, 0))
crv = Curve(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)

# ----
# Text
txt = Text()
# Number
num = Number()
# Box
box = Box()
# boolean
bool = Boolean()
# Integer
int = Integer()
# ここら辺もわかっとくと幅広がる
# Vector
vec = Vector()

# ----
# データの型に関する説明
# 各コンポーネントのinput,outputをしっかり確認することが大事
# inputとしてはBrepが必要
# outputとしてはsurface,curve,pointが書き出される
brep_2 = Brep([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])
debrep = DeconstructBrep()  # -> Faces, Edges, Vertices
srf_2 = Surface()
crv_2 = Curve()
pt_2 = Point()

# ----
# Pointに関する処理はVectorタブにまとまっている
panel = Panel(pt)
pdecon = Deconstruct(Point=pt)  # -> XComponent, YComponent, ZComponent
dist = Distance()

# ----
# Curveに関する処理はCurveタブにまとまっている
pcen = PolygonCenter(Polyline=crv)  # -> CenterV, CenterE, CenterA
end = EndPoints(Curve=crv)  # -> Start, End

# ----
# Surfaceに関する処理はSurfaceタブにまとまっている
srfpt = SurfacePoints(Surface=srf)  # -> Points, Weights, Greville, UCount, VCount
